# Dynamo graph Dynamo_rebar_foundation (new).dyn (Dynamo 2.10.1.3976)
# packages: Dynamo for Rebar 2.0.2, BIM4Struc.Rebar 1.3.0, Rhythm 2019.1.21, Clockwork for Dynamo 1.x 1.34.0

thanh_f2 = RebarBarType("25", ElementType="Autodesk.Revit.DB.Structure.RebarBarType, RevitAPI, Version=22.0.0.0, Culture=neutral, PublicKeyToken=null")  # graph input
getBarDiameter = Custom[RebarType.GetBarDiameter](rebarBarType=thanh_f2)  # package BIM4Struc.Rebar; Get the diameter of a given Rebar Bar Type
thanh_f1 = RebarBarType("32", ElementType="Autodesk.Revit.DB.Structure.RebarBarType, RevitAPI, Version=22.0.0.0, Culture=neutral, PublicKeyToken=null")  # graph input
getBarDiameter_2 = Custom[RebarType.GetBarDiameter](rebarBarType=thanh_f1)
code_block = CodeBlock(F1=getBarDiameter_2, F2=getBarDiameter) { Math.Max(F1,F2); }
thanh_f5 = RebarBarType("16", ElementType="Autodesk.Revit.DB.Structure.RebarBarType, RevitAPI, Version=22.0.0.0, Culture=neutral, PublicKeyToken=null")  # graph input
getBarDiameter_3 = Custom[RebarType.GetBarDiameter](rebarBarType=thanh_f5)

# group: Set Cover Bottom
chọn_bệ = DSModelElementSelection()  # 1 picked in the model; graph input
faces = Element.Faces(element=chọn_bệ)
code_block_2 = CodeBlock(p=faces) { p[0]; }
ZAxis = Vector.ZAxis()
cover_bottom = DoubleInput(150)
cover = DoubleInput(75)
code_block_3 = CodeBlock(x=cover, d=code_block, d2=getBarDiameter_3) { -x-d/2-d2/2; }
spacing_rebar = DoubleInput(150)  # graph input

code_block_4 = CodeBlock(x=cover_bottom, d=getBarDiameter) { x+d/2; }

# group (continued): Set Cover Bottom
translate = Geometry.Translate(geometry=code_block_2, direction=ZAxis, distance=code_block_4)
perimeterCurves = Surface.PerimeterCurves(surface=translate)
byJoinedCurves = PolyCurve.ByJoinedCurves(curves=perimeterCurves)

offset = Curve.Offset(curve=byJoinedCurves, distance=code_block_3)

# group (continued): Set Cover Bottom
explode = Geometry.Explode(geometry=offset)

chọn_host = DSModelElementSelection()  # 1 picked in the model; graph input
id = Element.Id(element=chọn_host)
rebar_style = RebarStyle("Standard", EnumerationType="Autodesk.Revit.DB.Structure.RebarStyle, RevitAPI, Version=22.0.0.0, Culture=neutral, PublicKeyToken=null")
rebar_hook_orientation = RebarHookOrientation("Left", EnumerationType="Autodesk.Revit.DB.Structure.RebarHookOrientation, RevitAPI, Version=22.0.0.0, Culture=neutral, PublicKeyToken=null")
rebar_hook_type = RevitRebarHookType("Standard - 90 deg", ElementType="Autodesk.Revit.DB.Structure.RebarHookType, RevitAPI, Version=22.0.0.0, Culture=neutral, PublicKeyToken=null")
XAxis = Vector.XAxis()
code_block_5 = CodeBlock { "Schedule Mark"; }
YAxis = Vector.YAxis()

# group: Chiều cao bệ
code_block_6 = CodeBlock { "Cao"; }
ʳʰʸᵗʰᵐ_elements = Rhythm.Revit.Elements.Elements.GetParameterValueByNameTypeOrInstance(element=chọn_bệ, parameterName=code_block_6)

thanh_f4 = RebarBarType("20", ElementType="Autodesk.Revit.DB.Structure.RebarBarType, RevitAPI, Version=22.0.0.0, Culture=neutral, PublicKeyToken=null")  # graph input
getBarDiameter_4 = Custom[RebarType.GetBarDiameter](rebarBarType=thanh_f4)
thanh_f3 = RebarBarType("20", ElementType="Autodesk.Revit.DB.Structure.RebarBarType, RevitAPI, Version=22.0.0.0, Culture=neutral, PublicKeyToken=null")  # graph input
getBarDiameter_5 = Custom[RebarType.GetBarDiameter](rebarBarType=thanh_f3)
reverse = Vector.Reverse(vector=XAxis)
reverse_2 = Vector.Reverse(vector=YAxis)
thanh_f6 = RebarBarType("16", ElementType="Autodesk.Revit.DB.Structure.RebarBarType, RevitAPI, Version=22.0.0.0, Culture=neutral, PublicKeyToken=null")  # graph input
getBarDiameter_6 = Custom[RebarType.GetBarDiameter](rebarBarType=thanh_f6)
rebar_style_2 = RebarStyle("Standard", EnumerationType="Autodesk.Revit.DB.Structure.RebarStyle, RevitAPI, Version=22.0.0.0, Culture=neutral, PublicKeyToken=null")
rebar_hook_orientation_2 = RebarHookOrientation("Left", EnumerationType="Autodesk.Revit.DB.Structure.RebarHookOrientation, RevitAPI, Version=22.0.0.0, Culture=neutral, PublicKeyToken=null")
rebar_hook_type_2 = RevitRebarHookType("Standard - 90 deg", ElementType="Autodesk.Revit.DB.Structure.RebarHookType, RevitAPI, Version=22.0.0.0, Culture=neutral, PublicKeyToken=null")
thanh_f7 = RebarBarType("16", ElementType="Autodesk.Revit.DB.Structure.RebarBarType, RevitAPI, Version=22.0.0.0, Culture=neutral, PublicKeyToken=null")  # graph input
getBarDiameter_7 = Custom[RebarType.GetBarDiameter](rebarBarType=thanh_f7)
thanh_f8 = RebarBarType("16", ElementType="Autodesk.Revit.DB.Structure.RebarBarType, RevitAPI, Version=22.0.0.0, Culture=neutral, PublicKeyToken=null")  # graph input
getBarDiameter_8 = Custom[RebarType.GetBarDiameter](rebarBarType=thanh_f8)
thanh_f9 = RebarBarType("16", ElementType="Autodesk.Revit.DB.Structure.RebarBarType, RevitAPI, Version=22.0.0.0, Culture=neutral, PublicKeyToken=null")  # graph input
getBarDiameter_9 = Custom[RebarType.GetBarDiameter](rebarBarType=thanh_f9)

# group: Thanh F1
cạnh_dài = CodeBlock(p=explode) { p[1]; }
code_block_7 = CodeBlock { 0.5; }
pointAtParameter = Curve.PointAtParameter(curve=cạnh_dài, param=code_block_7)
direction = Line.Direction(line=cạnh_dài)
length = Curve.Length(curve=cạnh_dài)
round = Math.Round(number=length)
code_block_8 = CodeBlock(n=round, space=spacing_rebar) { 0..n/2..space; }
translate_2 = Geometry.Translate(geometry=pointAtParameter, direction=direction, distance=code_block_8)
reverse_3 = Vector.Reverse(vector=direction)
code_block_9 = CodeBlock(space=spacing_rebar, n=round) { space..n/2..space; }
translate_3 = Geometry.Translate(geometry=pointAtParameter, direction=reverse_3, distance=code_block_9)
list_create = List.Create(item0=translate_2, item1=translate_3)
ZAxis_2 = Vector.ZAxis()
code_block_10 = CodeBlock(d1=getBarDiameter_2, d2=getBarDiameter) { (d1+d2)/2; }

# group: Thanh F2
cạnh_ngắn = CodeBlock(p=explode) { p[0]; }
direction_2 = Line.Direction(line=cạnh_ngắn)
reverse_4 = Vector.Reverse(vector=direction_2)
length_2 = Curve.Length(curve=cạnh_ngắn)
round_2 = Math.Round(number=length_2)
pointAtParameter_2 = Curve.PointAtParameter(curve=cạnh_ngắn, param=code_block_7)
code_block_11 = CodeBlock(n=round_2, space=spacing_rebar) { 0..n/2..space; }
translate_4 = Geometry.Translate(geometry=pointAtParameter_2, direction=direction_2, distance=code_block_11)
code_block_12 = CodeBlock(n=round_2, space=spacing_rebar) { 150..n/2..space; }
translate_5 = Geometry.Translate(geometry=pointAtParameter_2, direction=reverse_4, distance=code_block_12)
list_create_2 = List.Create(item0=translate_4, item1=translate_5)
byStartPointDirectionLength = Line.ByStartPointDirectionLength(startPoint=list_create_2@L1, direction=direction, length=round)
code_block_13 = CodeBlock { 0.5; }

# group (continued): Thanh F1
byStartPointDirectionLength_2 = Line.ByStartPointDirectionLength(startPoint=list_create@L1, direction=reverse_4, length=round_2)
translate_6 = Geometry.Translate(geometry=byStartPointDirectionLength_2, direction=ZAxis_2, distance=code_block_10)

byCurve = Rebar.ByCurve(curve=translate_6, hostElementId=id, rebarStyle=rebar_style, rebarBarType=thanh_f1, startHookOrientation=rebar_hook_orientation, endHookOrientation=rebar_hook_orientation, startHookType=rebar_hook_type, endHookType=rebar_hook_type, vector=XAxis)

# group: Rebar Name
code_block_14 = CodeBlock { "F1"; }
setParameterByName = Element.SetParameterByName(element=byCurve, parameterName=code_block_5, value=code_block_14)

byCurve_2 = Rebar.ByCurve(curve=byStartPointDirectionLength, hostElementId=id, rebarStyle=rebar_style, rebarBarType=thanh_f2, startHookOrientation=rebar_hook_orientation, endHookOrientation=rebar_hook_orientation, startHookType=rebar_hook_type, endHookType=rebar_hook_type, vector=YAxis)

# group: Rebar Name
code_block_15 = CodeBlock { "F2"; }
setParameterByName_2 = Element.SetParameterByName(element=byCurve_2, parameterName=code_block_5, value=code_block_15)

# group: Thanh F3
code_block_16 = CodeBlock(x=ʳʰʸᵗʰᵐ_elements, bot=cover_bottom, cov=cover, F2=getBarDiameter, F4=getBarDiameter_4, F3=getBarDiameter_5) { x-bot-cov-F2/2-F4-F3/2; }
translate_7 = Geometry.Translate(geometry=byStartPointDirectionLength_2, direction=ZAxis_2, distance=code_block_16)
code_block_17 = CodeBlock(max1=code_block, F3=getBarDiameter_5) { (max1-F3/2)/2; }
extendEnd = Curve.ExtendEnd(curve=translate_7, distance=code_block_17)
extendStart = Curve.ExtendStart(curve=extendEnd, distance=code_block_17)

byCurve_3 = Rebar.ByCurve(curve=extendStart, hostElementId=id, rebarStyle=rebar_style, rebarBarType=thanh_f3, startHookOrientation=rebar_hook_orientation, endHookOrientation=rebar_hook_orientation, startHookType=rebar_hook_type, endHookType=rebar_hook_type, vector=reverse)

# group: Rebar Name
code_block_18 = CodeBlock { "F3"; }
setParameterByName_3 = Element.SetParameterByName(element=byCurve_3, parameterName=code_block_5, value=code_block_18)

# group: Thanh F4
code_block_19 = CodeBlock(x=ʳʰʸᵗʰᵐ_elements, bot=cover_bottom, cov=cover, F2=getBarDiameter, F4=getBarDiameter_4) { x-bot-cov-F2/2-F4/2; }
translate_8 = Geometry.Translate(geometry=byStartPointDirectionLength, direction=ZAxis_2, distance=code_block_19)
code_block_20 = CodeBlock(max1=code_block, F4=getBarDiameter_4) { (max1-F4/2)/2; }
extendEnd_2 = Curve.ExtendEnd(curve=translate_8, distance=code_block_20)
extendStart_2 = Curve.ExtendStart(curve=extendEnd_2, distance=code_block_20)

byCurve_4 = Rebar.ByCurve(curve=extendStart_2, hostElementId=id, rebarStyle=rebar_style, rebarBarType=thanh_f4, startHookOrientation=rebar_hook_orientation, endHookOrientation=rebar_hook_orientation, startHookType=rebar_hook_type, endHookType=rebar_hook_type, vector=reverse_2)

# group: Rebar Name
code_block_21 = CodeBlock { "F4"; }
setParameterByName_4 = Element.SetParameterByName(element=byCurve_4, parameterName=code_block_5, value=code_block_21)

# group: Thanh F6
code_block_22 = CodeBlock(F1=getBarDiameter_2, F3=getBarDiameter_5, F6=getBarDiameter_6) { (Math.Max(F1,F3)+F6)/2; }
translate_9 = Geometry.Translate(geometry=list_create, direction=direction, distance=code_block_22)
code_block_23 = CodeBlock(max1=code_block, F6=getBarDiameter_6) { max1/2-F6/2; }
translate_10 = Geometry.Translate(geometry=translate_9, direction=direction_2, distance=code_block_23)
ZAxis_3 = Vector.ZAxis()
code_block_24 = CodeBlock(F2=getBarDiameter) { F2/2; }
translate_11 = Geometry.Translate(geometry=translate_10, direction=ZAxis_3, distance=code_block_24)
distanceTo = Geometry.DistanceTo(geometry=translate_6, other=extendStart_2)
code_block_25 = CodeBlock(x=distanceTo, F4=getBarDiameter_4, F6=getBarDiameter_6) { x-(F4+F6)/2; }
byStartPointDirectionLength_3 = Line.ByStartPointDirectionLength(startPoint=translate_11@L1, direction=ZAxis_2, length=code_block_25)
planeAtParameter = Curve.PlaneAtParameter(curve=cạnh_ngắn, param=code_block_7)
mirror = Geometry.Mirror(geometry=byStartPointDirectionLength_3, mirrorPlane=planeAtParameter)

byCurve_5 = Rebar.ByCurve(curve=byStartPointDirectionLength_3, hostElementId=id, rebarStyle=rebar_style_2, rebarBarType=thanh_f6, startHookOrientation=rebar_hook_orientation_2, endHookOrientation=rebar_hook_orientation_2, startHookType=rebar_hook_type_2, endHookType=rebar_hook_type_2, vector=direction)
byCurve_6 = Rebar.ByCurve(curve=mirror, hostElementId=id, rebarStyle=rebar_style_2, rebarBarType=thanh_f6, startHookOrientation=rebar_hook_orientation_2, endHookOrientation=rebar_hook_orientation_2, startHookType=rebar_hook_type_2, endHookType=rebar_hook_type_2, vector=reverse_3)
list_create_3 = List.Create(item0=byCurve_5, item1=byCurve_6)

# group: Rebar Name
code_block_26 = CodeBlock { "F6"; }
setParameterByName_5 = Element.SetParameterByName(element=list_create_3, parameterName=code_block_5, value=code_block_26)

# group: Thanh F5
firstItem = List.FirstItem(list=byStartPointDirectionLength_3)
code_block_27 = CodeBlock(F5=getBarDiameter_3, F6=getBarDiameter_6) { (F5+F6)/2; }
translate_12 = Geometry.Translate(geometry=firstItem, direction=reverse_4, distance=code_block_27)
code_block_28 = CodeBlock { 0.5; }
pointAtParameter_3 = Curve.PointAtParameter(curve=translate_12, param=code_block_28)
direction_3 = Line.Direction(line=firstItem)
distanceTo_2 = Geometry.DistanceTo(geometry=translate_6, other=translate_8)
code_block_29 = CodeBlock(p=distanceTo_2, space=spacing_rebar) { 0..p[0]/2..space; }
translate_13 = Geometry.Translate(geometry=pointAtParameter_3, direction=direction_3, distance=code_block_29)
reverse_5 = Vector.Reverse(vector=direction_3)
code_block_30 = CodeBlock(space=spacing_rebar, p=distanceTo_2) { space..p[0]/2..space; }
translate_14 = Geometry.Translate(geometry=pointAtParameter_3, direction=reverse_5, distance=code_block_30)
list_create_4 = List.Create(item0=translate_13, item1=translate_14)
code_block_31 = CodeBlock(n=round, F5=getBarDiameter_3, x=code_block_23) { n/2+1.5*F5+2*x; }
translate_15 = Geometry.Translate(geometry=list_create_4@L1, direction=reverse_3, distance=code_block_31)
code_block_32 = CodeBlock(x=round, F5=getBarDiameter_3) { x+2*F5; }
byStartPointDirectionLength_4 = Line.ByStartPointDirectionLength(startPoint=translate_15, direction=direction, length=code_block_32)
mirror_2 = Geometry.Mirror(geometry=byStartPointDirectionLength_4, mirrorPlane=planeAtParameter)

normal = Curve.Normal(curve=byStartPointDirectionLength_4)
byCurve_7 = Rebar.ByCurve(curve=byStartPointDirectionLength_4, hostElementId=id, rebarStyle=rebar_style, rebarBarType=thanh_f5, startHookOrientation=rebar_hook_orientation, endHookOrientation=rebar_hook_orientation, startHookType=rebar_hook_type, endHookType=rebar_hook_type, vector=normal)
reverse_6 = Vector.Reverse(vector=normal)
byCurve_8 = Rebar.ByCurve(curve=mirror_2, hostElementId=id, rebarStyle=rebar_style, rebarBarType=thanh_f5, startHookOrientation=rebar_hook_orientation, endHookOrientation=rebar_hook_orientation, startHookType=rebar_hook_type, endHookType=rebar_hook_type, vector=reverse_6)
list_create_5 = List.Create(item0=byCurve_7, item1=byCurve_8)

# group: Rebar Name
code_block_33 = CodeBlock { "F5"; }
setParameterByName_6 = Element.SetParameterByName(element=list_create_5, parameterName=code_block_5, value=code_block_33)

# group: Thanh F7
code_block_34 = CodeBlock(F5=getBarDiameter_3, F7=getBarDiameter_7) { (F5+F7)/2; }
translate_16 = Geometry.Translate(geometry=translate_15, direction=direction_3, distance=code_block_34)
code_block_35 = CodeBlock(x=round_2, F7=getBarDiameter_7) { x+2*F7; }
byStartPointDirectionLength_5 = Line.ByStartPointDirectionLength(startPoint=translate_16, direction=reverse_4, length=code_block_35)
planeAtParameter_2 = Curve.PlaneAtParameter(curve=cạnh_dài, param=code_block_7)
mirror_3 = Geometry.Mirror(geometry=byStartPointDirectionLength_5, mirrorPlane=planeAtParameter_2)

normal_2 = Curve.Normal(curve=byStartPointDirectionLength_5)
reverse_7 = Vector.Reverse(vector=normal_2)
byCurve_9 = Rebar.ByCurve(curve=byStartPointDirectionLength_5, hostElementId=id, rebarStyle=rebar_style, rebarBarType=thanh_f7, startHookOrientation=rebar_hook_orientation, endHookOrientation=rebar_hook_orientation, startHookType=rebar_hook_type, endHookType=rebar_hook_type, vector=reverse_7)
byCurve_10 = Rebar.ByCurve(curve=mirror_3, hostElementId=id, rebarStyle=rebar_style, rebarBarType=thanh_f7, startHookOrientation=rebar_hook_orientation, endHookOrientation=rebar_hook_orientation, startHookType=rebar_hook_type, endHookType=rebar_hook_type, vector=normal_2)
list_create_6 = List.Create(item0=byCurve_9, item1=byCurve_10)

# group: Rebar Name
code_block_36 = CodeBlock { "F7"; }
setParameterByName_7 = Element.SetParameterByName(element=list_create_6, parameterName=code_block_5, value=code_block_36)

# group: Thanh F8
code_block_37 = CodeBlock(F1=getBarDiameter_2, F3=getBarDiameter_5, F8=getBarDiameter_8) { (Math.Max(F1,F3)+F8)/2; }
translate_17 = Geometry.Translate(geometry=list_create_2, direction=direction_2, distance=code_block_37)
code_block_38 = CodeBlock(max1=code_block, F8=getBarDiameter_8) { max1/2-F8/2; }
translate_18 = Geometry.Translate(geometry=translate_17, direction=direction_2, distance=code_block_38)
byStartPointDirectionLength_6 = Line.ByStartPointDirectionLength(startPoint=translate_18, direction=ZAxis_2, length=code_block_16)
mirror_4 = Geometry.Mirror(geometry=byStartPointDirectionLength_6, mirrorPlane=planeAtParameter_2)

normal_3 = Curve.Normal(curve=byStartPointDirectionLength_6)
reverse_8 = Vector.Reverse(vector=normal_3)
byCurve_11 = Rebar.ByCurve(curve=byStartPointDirectionLength_6, hostElementId=id, rebarStyle=rebar_style, rebarBarType=thanh_f8, startHookOrientation=rebar_hook_orientation, endHookOrientation=rebar_hook_orientation, startHookType=rebar_hook_type, endHookType=rebar_hook_type, vector=reverse_8)
byCurve_12 = Rebar.ByCurve(curve=mirror_4, hostElementId=id, rebarStyle=rebar_style, rebarBarType=thanh_f8, startHookOrientation=rebar_hook_orientation, endHookOrientation=rebar_hook_orientation, startHookType=rebar_hook_type, endHookType=rebar_hook_type, vector=normal_3)
list_create_7 = List.Create(item0=byCurve_11, item1=byCurve_12)

# group: Rebar Name
code_block_39 = CodeBlock { "F8"; }
setParameterByName_8 = Element.SetParameterByName(element=list_create_7, parameterName=code_block_5, value=code_block_39)

# group: Thanh F9
lastItem = List.LastItem(list=translate_3)
code_block_40 = CodeBlock { 300; }
translate_19 = Geometry.Translate(geometry=lastItem, direction=direction, distance=code_block_40)
ZAxis_4 = Vector.ZAxis()
code_block_41 = CodeBlock(F1=getBarDiameter_2, F9=getBarDiameter_9) { F1+F9/2; }
translate_20 = Geometry.Translate(geometry=translate_19, direction=ZAxis_4, distance=code_block_41)
code_block_42 = CodeBlock(p=distanceTo_2, F4=getBarDiameter_4, F1=getBarDiameter_2, F9=getBarDiameter_9) { p[0]-F4/2-F1/2-F9/2; }
byStartPointDirectionLength_7 = Line.ByStartPointDirectionLength(startPoint=translate_20, direction=ZAxis_4, length=code_block_42)
distanceTo_3 = Geometry.DistanceTo(geometry=byStartPointDirectionLength_4, other=mirror_2)
round_3 = Math.Round(number=distanceTo_3)
code_block_43 = CodeBlock(p=round_3) { 600..p[0]..600; }
translate_21 = Geometry.Translate(geometry=byStartPointDirectionLength_7, direction=reverse_4, distance=code_block_43)
distanceTo_4 = Geometry.DistanceTo(geometry=byStartPointDirectionLength_5, other=mirror_3)
round_4 = Math.Round(number=distanceTo_4)
code_block_44 = CodeBlock(p=round_4) { p[0]; }
code_block_45 = CodeBlock(p=round_4) { 0..p[0]..600; }
lastItem_2 = List.LastItem(list=code_block_45)
sub = code_block_44 - lastItem_2
code_block_46 = CodeBlock { 600; }
lt = sub < code_block_46
dropLastItem = Custom[List.DropLastItem](list=code_block_45)  # package Clockwork for Dynamo 1.x; Drops the last item from a given list.
if_ = If(test=lt, true=dropLastItem, false=code_block_45)
translate_22 = Geometry.Translate(geometry=translate_21@L2, direction=direction, distance=if_, lacing=Longest)
code_block_47 = CodeBlock(p=round_3) { 300..p[0]..600; }
translate_23 = Geometry.Translate(geometry=byStartPointDirectionLength_7, direction=reverse_4, distance=code_block_47)
translate_24 = Geometry.Translate(geometry=translate_23, direction=direction, distance=code_block_40)
code_block_48 = CodeBlock { 300; }
lt_2 = sub < code_block_48
if_2 = If(test=lt_2, true=code_block_45, false=dropLastItem)
translate_25 = Geometry.Translate(geometry=translate_24@L2, direction=direction, distance=if_2, lacing=Longest)
list_create_8 = List.Create(item0=translate_22, item1=translate_25)

normal_4 = Curve.Normal(curve=list_create_8)
byCurve_13 = Rebar.ByCurve(curve=list_create_8, hostElementId=id, rebarStyle=rebar_style, rebarBarType=thanh_f9, startHookOrientation=rebar_hook_orientation, endHookOrientation=rebar_hook_orientation, startHookType=rebar_hook_type, endHookType=rebar_hook_type, vector=normal_4)

# group: Rebar Name
code_block_49 = CodeBlock { "F9"; }
setParameterByName_9 = Element.SetParameterByName(element=byCurve_13, parameterName=code_block_5, value=code_block_49)

list_create_9 = List.Create(item0=setParameterByName, item1=setParameterByName_2, item2=setParameterByName_3, item3=setParameterByName_4, item4=setParameterByName_5, item5=setParameterByName_6, item6=setParameterByName_7, item7=setParameterByName_8, item8=setParameterByName_9)
flatten = List.Flatten(list=list_create_9)

# group: Set Solid View
current = Document.Current()
activeView = Document.ActiveView(document=current)
boolean = BoolSelector(true)
setSolidInView = Custom[Rebar.SetSolidInView](rebarElements=flatten, views=activeView, solid=boolean, lacing=Longest)  # package BIM4Struc.Rebar; Sets this rebar element to be shown solidly in a 3D view.
