# Dynamo graph Rebar_T13_update_V2.dyn (Dynamo 4.1.1.5050)
# packages: Dynamo for Rebar 2.0.2, Clockwork for Dynamo 3.x 3.3.0

# group: Tạo các mặt cắt thanh thép
chọn_ref_plane_tạo_thanh_thép = DSModelElementSelection()  # nothing selected; graph input
plane = ReferencePlane.Plane(referencePlane=chọn_ref_plane_tạo_thanh_thép)
chọn_cạnh_theo_phương_ngang_cầu = DSEdgeSelection()  # "Chọn cạnh theo phương ngang cầu lấy vector"; nothing selected; graph input
endPoint = Curve.EndPoint(curve=chọn_cạnh_theo_phương_ngang_cầu)
startPoint = Curve.StartPoint(curve=chọn_cạnh_theo_phương_ngang_cầu)
byTwoPoints = Vector.ByTwoPoints(start=endPoint, end=startPoint)
code_block = CodeBlock { 0; 150; }
number = DoubleInput(58)
sequence = Sequence(start=code_block.out0, amount=number, step=code_block.out1)
translate = Geometry.Translate(geometry=plane, direction=byTwoPoints, distance=sequence)

# group: Lấy ra surface tạo hình thép
chọn_mặt_cong = SelectFaces()  # nothing selected; graph input
byJoinedSurfaces = PolySurface.ByJoinedSurfaces(surfaces=chọn_mặt_cong)
code_block_2 = CodeBlock { -81; }
offset = Surface.Offset(surface=byJoinedSurfaces, distance=code_block_2)
byJoinedSurfaces_2 = PolySurface.ByJoinedSurfaces(surfaces=offset)
code_block_3 = CodeBlock(a=byJoinedSurfaces_2) { a; }

# group: Lấy ra 2 điểm đầu - cuối thanh thép
intersect = Geometry.Intersect(geometry=translate, other=code_block_3, lacing=CrossProduct)
code_block_4 = CodeBlock { false; }
clean = List.Clean(list=intersect, preserveIndices=code_block_4)
code_block_5 = CodeBlock { 1; }
byJoinedCurves = PolyCurve.ByJoinedCurves(curves=clean, joinTolerance=code_block_5)
clean_2 = List.Clean(list=byJoinedCurves, preserveIndices=code_block_4)
code_block_6 = CodeBlock { 0..1..#20; }
pointAtParameter = Curve.PointAtParameter(curve=clean_2, param=code_block_6, lacing=CrossProduct)
byBestFitThroughPoints = Plane.ByBestFitThroughPoints(points=pointAtParameter@L2)
origin = Plane.Origin(plane=byBestFitThroughPoints)
byBestFitThroughPoints_2 = Plane.ByBestFitThroughPoints(points=origin)
normal = Plane.Normal(plane=byBestFitThroughPoints_2)
origin_2 = Plane.Origin(plane=byBestFitThroughPoints_2)
byTwoPoints_2 = Vector.ByTwoPoints(start=pointAtParameter, end=origin_2)
dot = Vector.Dot(vector=normal, vec=byTwoPoints_2)
sortByKey = List.SortByKey(list=pointAtParameter@L2, keys=dot@L2)
code_block_7 = CodeBlock(a=sortByKey.sortedList) { a; }
lastItem = List.LastItem(list=code_block_7@L2)
ZAxis = Vector.ZAxis()
code_block_8 = CodeBlock { 7000; }
translate_2 = Geometry.Translate(geometry=lastItem, direction=ZAxis, distance=code_block_8)
byStartPointEndPoint = Line.ByStartPointEndPoint(startPoint=lastItem, endPoint=translate_2)
chọn_ref_plane_đỉnh_trụ = DSModelElementSelection()  # nothing selected; graph input
plane_2 = ReferencePlane.Plane(referencePlane=chọn_ref_plane_đỉnh_trụ)
intersect_2 = Geometry.Intersect(geometry=byStartPointEndPoint, other=plane_2)
flatten = List.Flatten(list=intersect_2)
firstItem = List.FirstItem(list=code_block_7@L2)
translate_3 = Geometry.Translate(geometry=firstItem, direction=ZAxis, distance=code_block_8)
byStartPointEndPoint_2 = Line.ByStartPointEndPoint(startPoint=firstItem, endPoint=translate_3)
intersect_3 = Geometry.Intersect(geometry=byStartPointEndPoint_2, other=plane_2)
flatten_2 = List.Flatten(list=intersect_3)

# group: xử lý thứ tự các điểm point tại cung tròn
code_block_9 = CodeBlock { 0; }
length = Curve.Length(curve=clean_2)
code_block_10 = CodeBlock { 20; }
div = length / code_block_10
range = Range(start=code_block_9, end=length, step=div)
div_2 = range / length
pointAtParameter_2 = Curve.PointAtParameter(curve=clean_2, param=div_2)
byBestFitThroughPoints_3 = Plane.ByBestFitThroughPoints(points=pointAtParameter_2@L2)
origin_3 = Plane.Origin(plane=byBestFitThroughPoints_3)
byBestFitThroughPoints_4 = Plane.ByBestFitThroughPoints(points=origin_3)
origin_4 = Plane.Origin(plane=byBestFitThroughPoints_4)
byTwoPoints_3 = Vector.ByTwoPoints(start=origin_4, end=pointAtParameter_2)
normal_2 = Plane.Normal(plane=byBestFitThroughPoints_4)
dot_2 = Vector.Dot(vector=byTwoPoints_3, vec=normal_2)
sortByKey_2 = List.SortByKey(list=pointAtParameter_2@L2, keys=dot_2@L2)
code_block_11 = CodeBlock(a=sortByKey_2.sortedList) { a; }

list_create = List.Create(item0=flatten, item1=code_block_11, item2=flatten_2)
transpose = List.Transpose(lists=list_create)
normalizeDepth = List.NormalizeDepth(list=transpose@L3)
byPoints = PolyCurve.ByPoints(points=normalizeDepth)
firstItem_2 = List.FirstItem(list=byPoints)
reverse = Vector.Reverse(vector=byTwoPoints)
code_block_12 = CodeBlock { 0; 800; 150; }
range_2 = Range(start=code_block_12.out0, end=code_block_12.out1, step=code_block_12.out2)
translate_4 = Geometry.Translate(geometry=firstItem_2, direction=reverse, distance=range_2)
list_create_2 = List.Create(item0=byPoints, item1=translate_4)
flatten_3 = List.Flatten(list=list_create_2)
explode = Geometry.Explode(geometry=flatten_3)
code_block_13 = CodeBlock { 1; }
chop = List.Chop(list=explode, lengths=code_block_13)
chọn_host = DSModelElementSelection()  # nothing selected; graph input
id = Element.Id(element=chọn_host)
đường_kính_thép = RebarBarType("D16", ElementType="Autodesk.Revit.DB.Structure.RebarBarType, RevitAPI, Version=27.2.0.0, Culture=neutral, PublicKeyToken=null")  # graph input
freeFormRebarByCurves = Rebar.FreeFormRebarByCurves(curves=chop, hostElementId=id, rebarBarType=đường_kính_thép)
code_block_14 = CodeBlock { "Comments"; }
code_block_15 = CodeBlock { "T13"; }
setParameterByName = Element.SetParameterByName(element=freeFormRebarByCurves, parameterName=code_block_14, value=code_block_15)
chọn_ref_plane_mirror = DSModelElementSelection()  # nothing selected; graph input
plane_3 = ReferencePlane.Plane(referencePlane=chọn_ref_plane_mirror)
code_block_16 = CodeBlock { true; }
mirror = Custom[Element.Mirror](element=freeFormRebarByCurves, plane=plane_3, copy=code_block_16)  # package Clockwork for Dynamo 3.x; Mirrors an element about a given plane.
setParameterByName_2 = Element.SetParameterByName(element=mirror, parameterName=code_block_14, value=code_block_15)
